# Dynamo graph 00-Colocar elementos en una linea.dyn "prueba colocar elementos en una linea o elementov4" (Dynamo 2.3.0.5885)
# packages: Zhukoven.com 2019.5.7, Universo_BIM 19.10.11, spring nodes 203.1.0, IГIS 0.1.1

# group: Selecciona curva y pone los punto
seleccionar_donde_colocar = DSModelElementsSelection()  # 4 picked in the model; graph input
locationCurve = Elements.Element.LocationCurve(element=seleccionar_donde_colocar)

# group: Crea puntos en curva
code_block = CodeBlock { 0; }
code_block_2 = CodeBlock { 1; }
cantidad_de_elementos = DoubleSlider(10, range=1..100 step 1)  # graph input
div = code_block_2 / cantidad_de_elementos
range = Range(start=code_block, end=code_block_2, step=div)
pointsAtEqualChordLength = Curve.PointsAtEqualChordLength(curve=locationCurve, divisions=cantidad_de_elementos)
pointsAtEqualChordLength_2 = Curve.PointsAtEqualChordLength(divisions=cantidad_de_elementos)  # unwired: curve

# group: Subir elementos
X = Point.X(point=pointsAtEqualChordLength)
Y = Point.Y(point=pointsAtEqualChordLength)
altura_a_colocar = DoubleSlider(1, range=0..100 step 0.1)  # graph input
byCoordinates = Point.ByCoordinates(x=X, y=Y, z=altura_a_colocar)

# group: Seleccion de familia y colocarlos
selecionar_familia_a_colocar = FamilyTypes("Construction Trailer:32'")  # graph input
byPoint = FamilyInstance.ByPoint(familyType=selecionar_familia_a_colocar, point=byCoordinates)
ꟿ_familyinstance_byhostandpoint = Custom[ꟿ FamilyInstance.ByHostAndPoint](host=seleccionar_donde_colocar, point=byCoordinates)  # package spring nodes; Creates hosted family instances(doors/windows) at the specified points. You can feed either a single family type or a unique type for each instance.; unwired: type
nota = CodeBlock { Se debe cambiar el family type si quiere que sea host o seleccion con tangencial; }

# group (continued): Selecciona curva y pone los punto
parameterAtPoint = Curve.ParameterAtPoint(curve=locationCurve, point=pointsAtEqualChordLength)

# group: Gira tangencialmente
tangentAtParameter = Curve.TangentAtParameter(curve=locationCurve, param=parameterAtPoint)
gira_90_grados = BoolSelector(true)  # graph input
getRotation = Custom[Element.GetRotation](InputVector=tangentAtParameter, Rotate90=gira_90_grados)  # package Zhukoven.com; This node calculates rotation angle between selected element's vector and Y axis. Vector Z is used as rotation axis. Use resulting degree as an input to the FamilyInstance.SetRotation node.
setRotation = FamilyInstance.SetRotation(familyInstance=byPoint, degree=getRotation)

IГIS = Node_Storage()
