# Dynamo graph 00-Eliminar ( - ) family type name.dyn (Dynamo 2.0.3.8810)

categories = Categories(index=337)
categories_2 = Categories(index=344)  # graph input
create = List.Create(item0=categories, item1=categories_2)
all_elements_of_category = ElementsOfCategory(Category=create)
flatten = List.Flatten(list=all_elements_of_category)
elementType = Element.ElementType(element=flatten)
code_block = CodeBlock { "Type Name"; }
getParameterValueByName = Element.GetParameterValueByName(element=elementType, parameterName=code_block)
eliminar = StringInput(" - ")  # graph input
remplazar = StringInput("_")  # graph input
replace = String.Replace(str=getParameterValueByName, searchFor=eliminar, replaceWith=remplazar)
setName = Custom[Element.SetName](element=elementType, name=replace)  # Gets the name of a given Revit element
all_families_of_category = Custom[All Families Of Category](category=create)  # Gets all famiies of a given category in the model (does *not *work for system families)
name = Family.Name(family=all_families_of_category)
replace_2 = String.Replace(str=name, searchFor=eliminar, replaceWith=remplazar)
setName_2 = Custom[Element.SetName](element=all_families_of_category, name=replace_2)
