# Dynamo graph 01-Asignar AC a toda una categoria.dyn (Dynamo 2.0.3.8810)

categories_1 = Categories(index=337)  # graph input
categories_2 = Categories(index=344)  # graph input
create = List.Create(item0=categories_1, item1=categories_2)
all_elements_of_category = ElementsOfCategory(Category=create)
flatten = List.Flatten(list=all_elements_of_category)
elementType = Element.ElementType(element=flatten)
code_block = CodeBlock { "Assembly Code"; }
getParameterValueByName = Element.GetParameterValueByName(element=elementType, parameterName=code_block)
assembly_code_a_colocar = StringInput("D5010100")  # graph input
setParameterByName = Element.SetParameterByName(element=elementType, parameterName=code_block, value=assembly_code_a_colocar)
