# Dynamo graph 01_Worksets a un Parametro.dyn (Dynamo 2.3.0.5885)
# packages: Clockwork for Dynamo 2.x 2.3.0

all_elements_in_active_view = ElementsInView()
parametro_a_donde_colocar = StringInput("ZZ_SISTEMAS")  # "Parametro a donde colocar Workset"; graph input
workset = Custom[Element.Workset](element=all_elements_in_active_view)  # package Clockwork for Dynamo 2.x; Retrieves the workset of a given element
python_script = Python(IN[0]=workset)
# ---------- python_script.python (8 lines) ----------
import clr
clr.AddReference('RevitAPI')
from Autodesk.Revit.DB import*

if isinstance(IN[0],list):
	OUT = [i.Name for i in IN[0]]
else:
	OUT = IN[0].Name
# ----------------------------------------
setParameterByName = Element.SetParameterByName(element=all_elements_in_active_view, parameterName=parametro_a_donde_colocar, value=python_script)
requisitos = CodeBlock()  # unwired: clockwork
# ---------- requisitos.designscript (2 lines) ----------
Dynamo revit 2.3.0.8352
clockwork 2.3.0;
# ----------------------------------------
