# Dynamo graph 02-Asignar AC en family type name.dyn (Dynamo 2.0.3.8810)

categories_1 = Categories(index=337)  # graph input
categories_2 = Categories(index=344)  # graph input
create = List.Create(item0=categories_1, item1=categories_2)
all_elements_of_category = ElementsOfCategory(Category=create)
flatten = List.Flatten(list=all_elements_of_category)
elementType = Element.ElementType(element=flatten)
code_block = CodeBlock { "Assembly Code"; }
getParameterValueByName = Element.GetParameterValueByName(element=elementType, parameterName=code_block)
code_block_2 = CodeBlock { " - "; }
code_block_3 = CodeBlock { "Type Name"; }
getParameterValueByName_2 = Element.GetParameterValueByName(element=elementType, parameterName=code_block_3)
split = String.Split(str=getParameterValueByName_2, separater0=code_block_2)
transpose = List.Transpose(lists=split)
lastItem = List.LastItem(list=transpose)
code_block_4 = CodeBlock(New=getParameterValueByName, Sep=code_block_2, Original=lastItem) { New+Sep+Original; }
setName = Custom[Element.SetName](element=elementType, name=code_block_4)  # Gets the name of a given Revit element
