# Dynamo graph 02_Worksets a Filtros.dyn "02_Worksets a Filtros.2" (Dynamo 2.3.0.5885)
# packages: Bakery 2018.4.301

nombre_del_prefijo = StringInput("ZZ_SISTEMAS")  # graph input
code_block = CodeBlock { "_"; }
get_open_worksets = Custom[Get Open Worksets]()  # package Bakery; as sorted list
string_from_object = FromObject(obj=get_open_worksets)
flatten = List.Flatten(list=string_from_object)
code_block_2 = CodeBlock(a=nombre_del_prefijo, b=code_block, c=flatten) { a+b+c; }

# group: Electrico
code_block_3 = CodeBlock { "Cable Tray Fittings"; }
code_block_4 = CodeBlock { "Lighting Devices"; }
code_block_5 = CodeBlock { "Lighting Fixtures"; }
code_block_6 = CodeBlock { "Conduit Fittings"; }
code_block_7 = CodeBlock { "Conduit"; }
code_block_8 = CodeBlock { "Data Devices"; }
code_block_9 = CodeBlock { "Electrical Equipment"; }
code_block_10 = CodeBlock { "Electrical Fixtures"; }
code_block_11 = CodeBlock { "Nurse Call Devices"; }
code_block_12 = CodeBlock { "Security Devices"; }
code_block_13 = CodeBlock { "Switch System"; }
code_block_14 = CodeBlock { "Telephone Devices"; }
code_block_15 = CodeBlock { "Wires"; }
code_block_16 = CodeBlock { "Cable Trays"; }
code_block_17 = CodeBlock { "Fire Alarm Devices"; }
code_block_18 = CodeBlock { "Communication Devices"; }
list_create = List.Create(item0=code_block_3, item1=code_block_4, item2=code_block_5, item3=code_block_6, item4=code_block_7, item5=code_block_8, item6=code_block_9, item7=code_block_10, item8=code_block_11, item9=code_block_12, item10=code_block_13, item11=code_block_14, item12=code_block_15, item13=code_block_16, item14=code_block_17, item15=code_block_18)

# group: Sitio
code_block_19 = CodeBlock { "Planting"; }
code_block_20 = CodeBlock { "Roads"; }
code_block_21 = CodeBlock { "Site"; }
code_block_22 = CodeBlock { "Parking"; }
code_block_23 = CodeBlock { "Topography"; }
list_create_2 = List.Create(item0=code_block_19, item1=code_block_20, item2=code_block_21, item3=code_block_22, item4=code_block_23)

# group: Estructural
code_block_24 = CodeBlock { "Structural Area Reinforcement"; }
code_block_25 = CodeBlock { "Structural Beam Systems"; }
code_block_26 = CodeBlock { "Structural Columns"; }
code_block_27 = CodeBlock { "Structural Connections"; }
code_block_28 = CodeBlock { "Structural Fabric Areas"; }
code_block_29 = CodeBlock { "Structural Fabric Reinforcement"; }
code_block_30 = CodeBlock { "Structural Foundations"; }
code_block_31 = CodeBlock { "Structural Framing"; }
code_block_32 = CodeBlock { "Structural Path Reinforcement"; }
code_block_33 = CodeBlock { "Structural Rebar"; }
code_block_34 = CodeBlock { "Structural Rebar Couplers"; }
code_block_35 = CodeBlock { "Structural Stiffeners"; }
list_create_3 = List.Create(item0=code_block_24, item1=code_block_25, item2=code_block_26, item3=code_block_27, item4=code_block_28, item5=code_block_29, item6=code_block_30, item7=code_block_31, item8=code_block_32, item9=code_block_33, item10=code_block_34, item11=code_block_35)

# group: Arquitectura
code_block_36 = CodeBlock { "Casework"; }
code_block_37 = CodeBlock { "Ceilings"; }
code_block_38 = CodeBlock { "Columns"; }
code_block_39 = CodeBlock { "Curtain Panels"; }
code_block_40 = CodeBlock { "Curtain Wall Mullions"; }
code_block_41 = CodeBlock { "Doors"; }
code_block_42 = CodeBlock { "Entourage"; }
code_block_43 = CodeBlock { "Floors"; }
code_block_44 = CodeBlock { "Furniture"; }
code_block_45 = CodeBlock { "Furniture Systems"; }
code_block_46 = CodeBlock { "Railings"; }
code_block_47 = CodeBlock { "Ramps"; }
code_block_48 = CodeBlock { "Roofs"; }
code_block_49 = CodeBlock { "Stairs"; }
code_block_50 = CodeBlock { "Walls"; }
code_block_51 = CodeBlock { "Windows"; }
list_create_4 = List.Create(item0=code_block_36, item1=code_block_37, item2=code_block_38, item3=code_block_39, item4=code_block_40, item5=code_block_41, item6=code_block_42, item7=code_block_43, item8=code_block_44, item9=code_block_45, item10=code_block_46, item11=code_block_47, item12=code_block_48, item13=code_block_49, item14=code_block_50, item15=code_block_51)

# group: General
code_block_52 = CodeBlock { "Grids"; }
code_block_53 = CodeBlock { "Levels"; }
code_block_54 = CodeBlock { "Sections"; }
code_block_55 = CodeBlock { "Rooms"; }
code_block_56 = CodeBlock { "Spaces"; }
code_block_57 = CodeBlock { "System-Zones"; }
code_block_58 = CodeBlock { "Parts"; }
code_block_59 = CodeBlock { "Mass"; }
list_create_5 = List.Create(item0=code_block_52, item1=code_block_53, item2=code_block_54, item3=code_block_55, item4=code_block_56, item5=code_block_57, item6=code_block_58, item7=code_block_59)

# group: Mecanico
code_block_60 = CodeBlock { "Duct Accessories"; }
code_block_61 = CodeBlock { "Duct Fittings"; }
code_block_62 = CodeBlock { "Duct Insulations"; }
code_block_63 = CodeBlock { "Duct Linings"; }
code_block_64 = CodeBlock { "Duct Placeholders"; }
code_block_65 = CodeBlock { "Duct Systems"; }
code_block_66 = CodeBlock { "Ducts"; }
code_block_67 = CodeBlock { "Flex Ducts"; }
code_block_68 = CodeBlock { "Flex Pipes"; }
code_block_69 = CodeBlock { "Mechanical Equipment"; }
code_block_70 = CodeBlock { "Pipe Accessories"; }
code_block_71 = CodeBlock { "Pipe Fittings"; }
code_block_72 = CodeBlock { "Pipe Insulations"; }
code_block_73 = CodeBlock { "Pipe Placeholders"; }
code_block_74 = CodeBlock { "Pipes"; }
code_block_75 = CodeBlock { "Piping Systems"; }
code_block_76 = CodeBlock { "Plumbing Fixtures"; }
code_block_77 = CodeBlock { "Sprinklers"; }
list_create_6 = List.Create(item0=code_block_60, item1=code_block_61, item2=code_block_62, item3=code_block_63, item4=code_block_64, item5=code_block_65, item6=code_block_66, item7=code_block_67, item8=code_block_68, item9=code_block_69, item10=code_block_70, item11=code_block_71, item12=code_block_72, item13=code_block_73, item14=code_block_74, item15=code_block_75, item16=code_block_76, item17=code_block_77)

code_block_78 = CodeBlock { "Air Terminals"; }
code_block_79 = CodeBlock { "Shaft Openings"; }
code_block_80 = CodeBlock { "Specialty Equipment"; }
code_block_81 = CodeBlock { "Generic Models"; }
list_create_7 = List.Create(item0=code_block_78, item1=code_block_79, item2=code_block_80, item3=code_block_81)
code_block_82 = CodeBlock { "MEP Fabrication Containment"; }
code_block_83 = CodeBlock { "MEP Fabrication Ductwork"; }
code_block_84 = CodeBlock { "MEP Fabrication Hangers"; }
code_block_85 = CodeBlock { "MEP Fabrication Pipework"; }
list_create_8 = List.Create(item0=code_block_82, item1=code_block_83, item2=code_block_84, item3=code_block_85)
list_create_9 = List.Create(item0=list_create, item1=list_create_2, item2=list_create_3, item3=list_create_4, item4=list_create_5, item5=list_create_6, item6=list_create_7, item7=list_create_8)
flatten_2 = List.Flatten(list=list_create_9)
byName = Category.ByName(name=flatten_2)
select_rule_type = RuleTypes("Equals")
code_block_86 = CodeBlock { "Igual que Worksets_Copy"; }
categories = Categories("OST_Views")
all_elements_of_category = ElementsOfCategory(Category=categories)
firstItem = List.FirstItem(list=all_elements_of_category)
parameterByName = Parameter.ParameterByName(element=firstItem, name=nombre_del_prefijo)
byRuleType = Revit.Filter.FilterRule.ByRuleType(type=select_rule_type, value=code_block_86, parameter=parameterByName)
byRules = Revit.Filter.ParameterFilterElement.ByRules(name=code_block_2, categories=byName, rules=byRuleType)
end = Revit.Transaction.Transaction.End(input=byRules)
start = Revit.Transaction.Transaction.Start(input=end)
vista_donde_colocara_los_filtros = Views("BIM360")  # graph input
addFilter = View.AddFilter(view=vista_donde_colocara_los_filtros, parameterFilter=byRules)
code_block_87 = CodeBlock { "Balusters"; }
code_block_88 = CodeBlock { "Handrails"; }
code_block_89 = CodeBlock { "Supports"; }
code_block_90 = CodeBlock { "Reference Lines"; }
code_block_91 = CodeBlock { "Reference Planes"; }
code_block_92 = CodeBlock { "Terminations"; }
code_block_93 = CodeBlock { "Top Rails"; }
code_block_94 = CodeBlock { "Pads"; }
code_block_95 = CodeBlock { "Property Lines"; }
code_block_96 = CodeBlock { "Structural Trusses"; }
