# Dynamo graph 03-Asignar AC en family name.dyn (Dynamo 2.0.3.8810)

categories_1 = Categories(index=337)  # graph input
create = List.Create(item0=categories_1)
all_families_of_category = Custom[All Families Of Category](category=create)  # Gets all famiies of a given category in the model (does *not *work for system families)
uniqueItems = List.UniqueItems(list=all_families_of_category)
assembly_code_a_colocar = StringInput("A0000")  # graph input
code_block = CodeBlock { " - "; }
name = Family.Name(family=all_families_of_category)
flatten = List.Flatten(list=name)
split = String.Split(str=flatten, separater0=code_block)
transpose = List.Transpose(lists=split)
lastItem = List.LastItem(list=transpose)
code_block_2 = CodeBlock(New=assembly_code_a_colocar, Sep=code_block, Original=lastItem) { New+Sep+Original; }
setName = Custom[Element.SetName](element=uniqueItems, name=code_block_2)  # Gets the name of a given Revit element
