# Dynamo graph 03_Filtros a Otras Vistas.dyn (Dynamo 2.3.0.5885)
# packages: archi-lab.net 2020.23.13, Modelical 2.2.19

vista_que_toma_todos_los_filtros = Views("BIM360")  # graph input
tipo_de_vista = ViewTypesUi("View Template")
getByType = archilab.Revit.Views.Views.GetByType(viewType=tipo_de_vista)
copyAllFilters = Custom[CopyAllFilters](sourceView=vista_que_toma_todos_los_filtros, targetViews=getByType)  # package Modelical; Copy all the filters in a view and their graphics to other view(s).
view_type = ViewTypesUi("CeilingPlan")
getByType_2 = archilab.Revit.Views.Views.GetByType(viewType=view_type)
copyAllFilters_2 = Custom[CopyAllFilters](sourceView=vista_que_toma_todos_los_filtros, targetViews=getByType_2)
view_type_2 = ViewTypesUi("Elevation")
getByType_3 = archilab.Revit.Views.Views.GetByType(viewType=view_type_2)
copyAllFilters_3 = Custom[CopyAllFilters](sourceView=vista_que_toma_todos_los_filtros, targetViews=getByType_3)
view_type_3 = ViewTypesUi("FloorPlan")
getByType_4 = archilab.Revit.Views.Views.GetByType(viewType=view_type_3)
copyAllFilters_4 = Custom[CopyAllFilters](sourceView=vista_que_toma_todos_los_filtros, targetViews=getByType_4)
view_type_4 = ViewTypesUi("Section")
getByType_5 = archilab.Revit.Views.Views.GetByType(viewType=view_type_4)
copyAllFilters_5 = Custom[CopyAllFilters](sourceView=vista_que_toma_todos_los_filtros, targetViews=getByType_5)
view_type_5 = ViewTypesUi("ThreeD")
getByType_6 = archilab.Revit.Views.Views.GetByType(viewType=view_type_5)
copyAllFilters_6 = Custom[CopyAllFilters](sourceView=vista_que_toma_todos_los_filtros, targetViews=getByType_6)
