# Dynamo graph 04_Visibilidad de los Filtros.dyn (Dynamo 2.3.0.5885)
# packages: Rhythm 2020.1.24, archi-lab.net 2020.23.13

tipo_de_vista_a_actualizar = ViewTypesUi("CeilingPlan")  # graph input
getByType = archilab.Revit.Views.Views.GetByType(viewType=tipo_de_vista_a_actualizar)

# group: Filtros iguales a parametros
filters = View.Filters(view=getByType)
name = Element.Name(element=filters)
code_block = CodeBlock { "ZZ_SISTEMAS"; }
contains = String.Contains(str=name, searchFor=code_block)
filterByBoolMask = List.FilterByBoolMask(list=filters, mask=contains)

# group: seleccion de worksets
workset_kind = WorksetKindUi("UserWorkset")
getAllWorksetsByKind = archilab.Revit.Selection.Select.GetAllWorksetsByKind(kind=workset_kind)

name_2 = archilab.Revit.Elements.Workset.Name(workset=getAllWorksetsByKind)
sortByKey = List.SortByKey(list=getAllWorksetsByKind, keys=name_2)

# group (continued): seleccion de worksets
id = archilab.Revit.Elements.Workset.Id(workset=sortByKey.sorted_list)

# group: Booleano de visivilidad
ʳʰʸᵗʰᵐ_view_getworksetvisibility = Rhythm.Revit.Views.View.GetWorksetVisibility(view=getByType, worksetId=id)
code_block_2 = CodeBlock { "Use Global Setting (Visible)"; }
code_block_3 = CodeBlock { "Show"; }
replace = String.Replace(str=ʳʰʸᵗʰᵐ_view_getworksetvisibility, searchFor=code_block_2, replaceWith=code_block_3)
contains_2 = String.Contains(str=replace, searchFor=code_block_3)

# group: Sobre escribir visivilidad
byProperties = Revit.Filter.OverrideGraphicSettings.ByProperties()
setFilterOverrides = View.SetFilterOverrides(view=getByType, parameterFilter=filterByBoolMask.in, overrides=byProperties, hide=contains_2)
watch = Watch(setFilterOverrides)

name_3 = archilab.Revit.Elements.Workset.Name(workset=sortByKey.sorted_list)

# group: seleccion de worksets
workset_kind_2 = WorksetKindUi("UserWorkset")
getAllWorksetsByKind_2 = archilab.Revit.Selection.Select.GetAllWorksetsByKind(kind=workset_kind_2)

name_4 = archilab.Revit.Elements.Workset.Name(workset=getAllWorksetsByKind_2)
sortByKey_2 = List.SortByKey(list=getAllWorksetsByKind_2, keys=name_4)
name_5 = archilab.Revit.Elements.Workset.Name(workset=sortByKey_2.sorted_list)
tipo_de_vista_a_actualizar_2 = ViewTypesUi("Elevation")  # graph input
getByType_2 = archilab.Revit.Views.Views.GetByType(viewType=tipo_de_vista_a_actualizar_2)

# group: Filtros iguales a parametros
filters_2 = View.Filters(view=getByType_2)
name_6 = Element.Name(element=filters_2)
code_block_4 = CodeBlock { "ZZ_SISTEMAS"; }
contains_3 = String.Contains(str=name_6, searchFor=code_block_4)
filterByBoolMask_2 = List.FilterByBoolMask(list=filters_2, mask=contains_3)

# group (continued): seleccion de worksets
id_2 = archilab.Revit.Elements.Workset.Id(workset=sortByKey_2.sorted_list)

# group: Booleano de visivilidad
ʳʰʸᵗʰᵐ_view_getworksetvisibility_2 = Rhythm.Revit.Views.View.GetWorksetVisibility(view=getByType_2, worksetId=id_2)
code_block_5 = CodeBlock { "Use Global Setting (Visible)"; }
code_block_6 = CodeBlock { "Show"; }
replace_2 = String.Replace(str=ʳʰʸᵗʰᵐ_view_getworksetvisibility_2, searchFor=code_block_5, replaceWith=code_block_6)
contains_4 = String.Contains(str=replace_2, searchFor=code_block_6)

# group: Sobre escribir visivilidad
byProperties_2 = Revit.Filter.OverrideGraphicSettings.ByProperties()
setFilterOverrides_2 = View.SetFilterOverrides(view=getByType_2, parameterFilter=filterByBoolMask_2.in, overrides=byProperties_2, hide=contains_4)
watch_2 = Watch(setFilterOverrides_2)

# group: seleccion de worksets
workset_kind_3 = WorksetKindUi("UserWorkset")
getAllWorksetsByKind_3 = archilab.Revit.Selection.Select.GetAllWorksetsByKind(kind=workset_kind_3)

name_7 = archilab.Revit.Elements.Workset.Name(workset=getAllWorksetsByKind_3)
sortByKey_3 = List.SortByKey(list=getAllWorksetsByKind_3, keys=name_7)
name_8 = archilab.Revit.Elements.Workset.Name(workset=sortByKey_3.sorted_list)

# group: seleccion de worksets
workset_kind_4 = WorksetKindUi("UserWorkset")
getAllWorksetsByKind_4 = archilab.Revit.Selection.Select.GetAllWorksetsByKind(kind=workset_kind_4)

name_9 = archilab.Revit.Elements.Workset.Name(workset=getAllWorksetsByKind_4)
sortByKey_4 = List.SortByKey(list=getAllWorksetsByKind_4, keys=name_9)
name_10 = archilab.Revit.Elements.Workset.Name(workset=sortByKey_4.sorted_list)
tipo_de_vista_a_actualizar_3 = ViewTypesUi("Section")  # graph input
getByType_3 = archilab.Revit.Views.Views.GetByType(viewType=tipo_de_vista_a_actualizar_3)

# group: Filtros iguales a parametros
filters_3 = View.Filters(view=getByType_3)
name_11 = Element.Name(element=filters_3)
code_block_7 = CodeBlock { "ZZ_SISTEMAS"; }
contains_5 = String.Contains(str=name_11, searchFor=code_block_7)
filterByBoolMask_3 = List.FilterByBoolMask(list=filters_3, mask=contains_5)

# group (continued): seleccion de worksets
id_3 = archilab.Revit.Elements.Workset.Id(workset=sortByKey_4.sorted_list)

# group: Booleano de visivilidad
ʳʰʸᵗʰᵐ_view_getworksetvisibility_3 = Rhythm.Revit.Views.View.GetWorksetVisibility(view=getByType_3, worksetId=id_3)
code_block_8 = CodeBlock { "Use Global Setting (Visible)"; }
code_block_9 = CodeBlock { "Show"; }
replace_3 = String.Replace(str=ʳʰʸᵗʰᵐ_view_getworksetvisibility_3, searchFor=code_block_8, replaceWith=code_block_9)
contains_6 = String.Contains(str=replace_3, searchFor=code_block_9)

# group: Sobre escribir visivilidad
byProperties_3 = Revit.Filter.OverrideGraphicSettings.ByProperties()
setFilterOverrides_3 = View.SetFilterOverrides(view=getByType_3, parameterFilter=filterByBoolMask_3.in, overrides=byProperties_3, hide=contains_6)
watch_3 = Watch(setFilterOverrides_3)

tipo_de_vista_a_actualizar_4 = ViewTypesUi("FloorPlan")  # graph input
getByType_4 = archilab.Revit.Views.Views.GetByType(viewType=tipo_de_vista_a_actualizar_4)

# group: Filtros iguales a parametros
filters_4 = View.Filters(view=getByType_4)
name_12 = Element.Name(element=filters_4)
code_block_10 = CodeBlock { "ZZ_SISTEMAS"; }
contains_7 = String.Contains(str=name_12, searchFor=code_block_10)
filterByBoolMask_4 = List.FilterByBoolMask(list=filters_4, mask=contains_7)

# group (continued): seleccion de worksets
id_4 = archilab.Revit.Elements.Workset.Id(workset=sortByKey_3.sorted_list)

# group: Booleano de visivilidad
ʳʰʸᵗʰᵐ_view_getworksetvisibility_4 = Rhythm.Revit.Views.View.GetWorksetVisibility(view=getByType_4, worksetId=id_4)
code_block_11 = CodeBlock { "Use Global Setting (Visible)"; }
code_block_12 = CodeBlock { "Show"; }
replace_4 = String.Replace(str=ʳʰʸᵗʰᵐ_view_getworksetvisibility_4, searchFor=code_block_11, replaceWith=code_block_12)
contains_8 = String.Contains(str=replace_4, searchFor=code_block_12)

# group: Sobre escribir visivilidad
byProperties_4 = Revit.Filter.OverrideGraphicSettings.ByProperties()
setFilterOverrides_4 = View.SetFilterOverrides(view=getByType_4, parameterFilter=filterByBoolMask_4.in, overrides=byProperties_4, hide=contains_8)
watch_4 = Watch(setFilterOverrides_4)

# group: seleccion de worksets
workset_kind_5 = WorksetKindUi("UserWorkset")
getAllWorksetsByKind_5 = archilab.Revit.Selection.Select.GetAllWorksetsByKind(kind=workset_kind_5)

name_13 = archilab.Revit.Elements.Workset.Name(workset=getAllWorksetsByKind_5)
sortByKey_5 = List.SortByKey(list=getAllWorksetsByKind_5, keys=name_13)
name_14 = archilab.Revit.Elements.Workset.Name(workset=sortByKey_5.sorted_list)
tipo_de_vista_a_actualizar_5 = ViewTypesUi("View Template")  # graph input
getByType_5 = archilab.Revit.Views.Views.GetByType(viewType=tipo_de_vista_a_actualizar_5)

# group: Filtros iguales a parametros
filters_5 = View.Filters(view=getByType_5)
name_15 = Element.Name(element=filters_5)
code_block_13 = CodeBlock { "ZZ_SISTEMAS"; }
contains_9 = String.Contains(str=name_15, searchFor=code_block_13)
filterByBoolMask_5 = List.FilterByBoolMask(list=filters_5, mask=contains_9)

# group: seleccion de worksets
workset_kind_6 = WorksetKindUi("UserWorkset")
getAllWorksetsByKind_6 = archilab.Revit.Selection.Select.GetAllWorksetsByKind(kind=workset_kind_6)

name_16 = archilab.Revit.Elements.Workset.Name(workset=getAllWorksetsByKind_6)
sortByKey_6 = List.SortByKey(list=getAllWorksetsByKind_6, keys=name_16)

# group (continued): seleccion de worksets
id_5 = archilab.Revit.Elements.Workset.Id(workset=sortByKey_6.sorted_list)

# group: Booleano de visivilidad
ʳʰʸᵗʰᵐ_view_getworksetvisibility_5 = Rhythm.Revit.Views.View.GetWorksetVisibility(view=getByType_5, worksetId=id_5)
code_block_14 = CodeBlock { "Use Global Setting (Visible)"; }
code_block_15 = CodeBlock { "Show"; }
replace_5 = String.Replace(str=ʳʰʸᵗʰᵐ_view_getworksetvisibility_5, searchFor=code_block_14, replaceWith=code_block_15)
contains_10 = String.Contains(str=replace_5, searchFor=code_block_15)

# group: Sobre escribir visivilidad
byProperties_5 = Revit.Filter.OverrideGraphicSettings.ByProperties()
setFilterOverrides_5 = View.SetFilterOverrides(view=getByType_5, parameterFilter=filterByBoolMask_5.in, overrides=byProperties_5, hide=contains_10)
watch_5 = Watch(setFilterOverrides_5)

name_17 = archilab.Revit.Elements.Workset.Name(workset=sortByKey_6.sorted_list)
tipo_de_vista_a_actualizar_6 = ViewTypesUi("ThreeD")  # graph input
getByType_6 = archilab.Revit.Views.Views.GetByType(viewType=tipo_de_vista_a_actualizar_6)

# group: Filtros iguales a parametros
filters_6 = View.Filters(view=getByType_6)
name_18 = Element.Name(element=filters_6)
code_block_16 = CodeBlock { "ZZ_SISTEMAS"; }
contains_11 = String.Contains(str=name_18, searchFor=code_block_16)
filterByBoolMask_6 = List.FilterByBoolMask(list=filters_6, mask=contains_11)

# group (continued): seleccion de worksets
id_6 = archilab.Revit.Elements.Workset.Id(workset=sortByKey_5.sorted_list)

# group: Booleano de visivilidad
ʳʰʸᵗʰᵐ_view_getworksetvisibility_6 = Rhythm.Revit.Views.View.GetWorksetVisibility(view=getByType_6, worksetId=id_6)
code_block_17 = CodeBlock { "Use Global Setting (Visible)"; }
code_block_18 = CodeBlock { "Show"; }
replace_6 = String.Replace(str=ʳʰʸᵗʰᵐ_view_getworksetvisibility_6, searchFor=code_block_17, replaceWith=code_block_18)
contains_12 = String.Contains(str=replace_6, searchFor=code_block_18)

# group: Sobre escribir visivilidad
byProperties_6 = Revit.Filter.OverrideGraphicSettings.ByProperties()
setFilterOverrides_6 = View.SetFilterOverrides(view=getByType_6, parameterFilter=filterByBoolMask_6.in, overrides=byProperties_6, hide=contains_12)
watch_6 = Watch(setFilterOverrides_6)
