# Dynamo graph Modelado Tuberías - Paquete Universo BIM.dyn (Dynamo 1.3.4.6666)

select_model_elements = DSModelElementsSelection()  # 6 picked in the model
curves = Element.Curves(select_model_elements)
nameCollector = Elements.PipingSystemType.NameCollector()
code_block = CodeBlock(out=nameCollector) { out[5]; }
byName = Elements.PipingSystemType.ByName(code_block)
nameCollector_2 = Elements.PipeType.NameCollector()
code_block_2 = CodeBlock(Tuberia=nameCollector_2) { Tuberia[0]; }
byName_2 = Elements.PipeType.ByName(code_block_2)
levels = Levels("E-06_Piso 2")
byCurve = Elements.Pipe.ByCurve(curves, byName, byName_2, levels)
code_block_3 = CodeBlock { "Offset"; }
code_block_4 = CodeBlock { -0.15; }
setParameterByName = Element.SetParameterByName(element=byCurve, parameterName=code_block_3, value=code_block_4)
