# Dynamo graph Muros desde Líneas.dyn (Dynamo 1.3.4.6666)

select_model_elements = DSModelElementsSelection()  # 6 picked in the model
curves = Element.Curves(select_model_elements)
code_block = CodeBlock { 5; }
levels = Levels("E-06_Piso 2")
wall_types = WallTypes("Placa 30cm")
byCurveAndHeight = Wall.ByCurveAndHeight(curve=curves, height=code_block, level=levels, wallType=wall_types)
