# Dynamo graph Tuberías automáticas.dyn (Dynamo 2.6.1.8786)
# packages: Universo_BIM 19.10.11

select_model_elements = DSModelElementsSelection()  # 2 picked in the model
curves = Element.Curves(element=select_model_elements)
nameCollector = Elements.PipingSystemType.NameCollector()
code_block = CodeBlock(out=nameCollector) { out[5]; }
byName = Elements.PipingSystemType.ByName(name=code_block)
nameCollector_2 = Elements.PipeType.NameCollector()
code_block_2 = CodeBlock(Tubería=nameCollector_2) { Tubería[0]; }
levels = Levels("E-06_Piso 2")
byCurve = Elements.Pipe.ByCurve(curve=curves, pipingSystemType=byName, pipeType=code_block_2, level=levels)
code_block_3 = CodeBlock { "Elevación intermedia"; }
code_block_4 = CodeBlock { 0.20; }
setParameterByName = Element.SetParameterByName(parameterName=code_block_3, value=code_block_4)  # unwired: element
